# Dynamo graph readAnalyticalModel_python.dyn (Dynamo 0.8.0.950)

select_model_elements = DSModelElementsSelection()  # 336 picked in the model
python_script = Python(IN[0]=select_model_elements)
# ---------- python_script.python (30 lines) ----------
import clr
clr.AddReference('RevitAPI')
from Autodesk.Revit.DB import *
from Autodesk.Revit.DB import Structure

clr.AddReference("RevitServices")
import RevitServices
from RevitServices.Persistence import DocumentManager

clr.AddReference("RevitNodes")
import Revit
clr.ImportExtensions(Revit.GeometryConversion)

doc = DocumentManager.Instance.CurrentDBDocument
items = UnwrapElement(IN[0])
typelist = list()
mm = list()
for item in items:
	try: 
		typelist.append(doc.GetElement(item.Id))
		
		startPoint = (doc.GetElement(item.Id)).GetCurve().ToProtoType()
		

		mm.append(startPoint)
	except:
		#typelist.append(list())
		t="no"
		
OUT = mm
# ----------------------------------------
name = Family.Name(select_model_elements)
python_script_2 = Python(IN[0]=name)
# ---------- python_script_2.python (22 lines) ----------
import clr
clr.AddReference('RevitAPI')
from Autodesk.Revit.DB import *
from Autodesk.Revit.DB import Structure

clr.AddReference("RevitServices")
import RevitServices
from RevitServices.Persistence import DocumentManager

clr.AddReference("RevitNodes")
import Revit
clr.ImportExtensions(Revit.GeometryConversion)

doc = DocumentManager.Instance.CurrentDBDocument
items = UnwrapElement(IN[0])
typelist = list()
mm = list()
for item in items:
	if (item != ""):
		mm.append(item)
		
OUT = mm
# ----------------------------------------
sectionCatalogs = SectionCatalogs("AISC")
define = DynamoSAP.Definitions.SectionProp.Define(python_script_2, arg2=sectionCatalogs)
fromLine = DynamoSAP.Structure.Frame.FromLine(python_script, define)
collector = DynamoSAP.Assembly.StructuralModel.Collector(fromLine)
boolean = BoolSelector(false)
toSAP = DynamoSAP.Assembly.Bake.ToSAP(collector, boolean)
sections = DynamoSAP.Definitions.SectionProp.Sections(sectionCatalogs)
