# Dynamo graph Sample_1a_SpaceStructure.dyn (Dynamo 0.8.0.950)

byCoordinates = Point.ByCoordinates()
# note: Space Frame Geometry Parameters
number_slider = DoubleSlider(6.504, range=0..100 step 0.1)
number_slider_2 = DoubleSlider(16, range=0..100 step 0.1)
number_slider_3 = DoubleSlider(10, range=0..100 step 0.1)
byCoordinates_2 = Point.ByCoordinates(x=number_slider, y=number_slider_2, z=number_slider_3)
number_slider_4 = DoubleSlider(16, range=0..100 step 0.1)
number_slider_5 = DoubleSlider(50, range=0..100 step 0.1)
byCoordinates_3 = Point.ByCoordinates(x=number_slider_4, y=number_slider_5)
byThreePoints = Arc.ByThreePoints(firstPoint=byCoordinates, secondPoint=byCoordinates_2, thirdPoint=byCoordinates_3)
number_slider_6 = DoubleSlider(-5, range=-10..100 step 0.1)
byCoordinates_4 = Point.ByCoordinates(x=number_slider_6)
number_slider_7 = DoubleSlider(15, range=0..100 step 0.1)
number_slider_8 = DoubleSlider(10, range=0..100 step 0.1)
byCoordinates_5 = Point.ByCoordinates(x=number_slider_6, y=number_slider_7, z=number_slider_8)
number_slider_9 = DoubleSlider(50, range=0..100 step 0.1)
byCoordinates_6 = Point.ByCoordinates(x=number_slider_6, y=number_slider_9)
byThreePoints_2 = Arc.ByThreePoints(firstPoint=byCoordinates_4, secondPoint=byCoordinates_5, thirdPoint=byCoordinates_6)
create = List.Create(byThreePoints, byThreePoints_2)
byLoft = Surface.ByLoft(create)
integer_slider = IntegerSlider(4, range=0..100 step 1)
integer_slider_2 = IntegerSlider(5, range=0..100 step 1)
lunchbox_space_truss_structure = Custom[LunchBox Space Truss Structure](Surface=byLoft, U=integer_slider, V=integer_slider, Depth=integer_slider_2)  # Create a space truss using a surface.
create_2 = List.Create(lunchbox_space_truss_structure.CenterlinesA, lunchbox_space_truss_structure.CenterlinesB, lunchbox_space_truss_structure.CenterlinesC, lunchbox_space_truss_structure.CenterlinesD, lunchbox_space_truss_structure.CenterlinesE)
# note: Space Frame Geometry
flatten = Flatten(create_2)
sectionCatalogs = SectionCatalogs("AISC14")
# note: Get Sections Names from given Section Catalog (Make sure SAP Model is Open )
sections = DynamoSAP.Definitions.SectionProp.Sections(sectionCatalogs)
code_block = CodeBlock(x=sections) { x[1902]; }
section_name = Watch(code_block)
materials = Materials("A992Fy50")
# note: Define Section Property for Frames
define = DynamoSAP.Definitions.SectionProp.Define(section_name, materials, sectionCatalogs)
# note: Define Frame from Line
fromLine = DynamoSAP.Structure.Frame.FromLine(flatten, define)
# note: Collector for Structural Model
collector = DynamoSAP.Assembly.StructuralModel.Collector(fromLine)
boolean = BoolSelector(true)
units = Units("kip_ft_F")
# note: Bake to SAP model! set Delete true if you like overwrite the existing model.
toSAP = DynamoSAP.Assembly.Bake.ToSAP(collector, boolean, units)
