# Dynamo graph Sample_1c_ShellStructure.dyn (Dynamo 0.7.5.3566)

byCoordinates = Point.ByCoordinates()
# note: Space Frame Geometry Parameters
double_slider = DoubleSlider(6.504, range=0..100)
double_slider_2 = DoubleSlider(0, range=0..100)
double_slider_3 = DoubleSlider(10, range=0..100)
byCoordinates_2 = Point.ByCoordinates(double_slider, double_slider_2, double_slider_3)
double_slider_4 = DoubleSlider(0, range=0..100)
double_slider_5 = DoubleSlider(50, range=0..100)
byCoordinates_3 = Point.ByCoordinates(double_slider_4, double_slider_5)
byThreePoints = Arc.ByThreePoints(byCoordinates, byCoordinates_2, byCoordinates_3)
double_slider_6 = DoubleSlider(-15, range=-15..100)
byCoordinates_4 = Point.ByCoordinates(double_slider_6)
double_slider_7 = DoubleSlider(15, range=0..100)
double_slider_8 = DoubleSlider(10, range=0..100)
byCoordinates_5 = Point.ByCoordinates(double_slider_6, double_slider_7, double_slider_8)
double_slider_9 = DoubleSlider(50, range=0..100)
byCoordinates_6 = Point.ByCoordinates(double_slider_6, double_slider_9)
byThreePoints_2 = Arc.ByThreePoints(byCoordinates_4, byCoordinates_5, byCoordinates_6)
create = List.Create(byThreePoints, byThreePoints_2)
byLoft = Surface.ByLoft(create)
integer_slider = IntegerSlider(10, range=0..100)
integer_slider_2 = IntegerSlider(10, range=0..100)
# note: Shell Geometry
lunchbox_triangle_grid_by_face = Custom[LunchBox Triangle Grid by Face](Surface=byLoft, U=integer_slider, V=integer_slider_2)  # Create a Triangular XYZ grid on a face. The face surface must have an untrimmed UV parameter space.
code_block = CodeBlock { "Dyn_Con_12"; }
shellTypes = ShellTypes("Shell_thin")
materials = Materials("Concrete_4000Psi")
code_block_2 = CodeBlock { 12; }
# note: Define Shell Property for Shells
define = DynamoSAP.Definitions.ShellProp.Define(code_block, shellTypes, arg3=materials, arg5=code_block_2, arg6=code_block_2)
# note: Define Shell from Surface
fromSurface = DynamoSAP.Structure.Shell.FromSurface(lunchbox_triangle_grid_by_face.Panel_Faces, define)
# note: Collector for Structural Model
collector = DynamoSAP.Assembly.StructuralModel.Collector(fromSurface)
boolean = BoolSelector(true)
units = Units("kN_m_C")
# note: Bake to SAP model! set Delete true if you like overwrite the existing model.
toSAP = DynamoSAP.Assembly.Bake.ToSAP(collector, boolean, units)
