# Dynamo graph Sample_2b_Read_Shell+DecomposeSapModel.dyn (Dynamo 1.1.0.2094)

# note: OR Browse existing Simple Shell Structure SAP Model
SAPModel = DynamoSAP.Assembly.Read.SAPModel()
file_path = Filename("No file selected.")
boolean = BoolSelector(true)
boolean_2 = BoolSelector(true)
# note: Grabs open SAP instance
SAPModel_2 = DynamoSAP.Assembly.Read.SAPModel(boolean_2)
# note: Decompose Structural Model
decompose = DynamoSAP.Assembly.StructuralModel.Decompose(SAPModel_2)
# note: Decompose Shell
decompose_2 = DynamoSAP.Structure.Shell.Decompose(decompose.out1)
# note: Decompose Shell Property
decompose_3 = DynamoSAP.Definitions.ShellProp.Decompose(decompose_2.out2)
