# Dynamo graph Frame testing.dyn (Dynamo 0.7.5.3370)

byCoordinates = Point.ByCoordinates()
code_block = CodeBlock { 3; }
byCoordinates_2 = Point.ByCoordinates(arg2=code_block)
define = DynamoSAP.Structure.SectionProp.Define()
fromEndPoints = DynamoSAP.Structure.Frame.FromEndPoints(byCoordinates, byCoordinates_2, define)
decompose = DynamoSAP.Structure.Frame.Decompose(fromEndPoints)
code_block_2 = CodeBlock { "Frame_loadp"; }
loadPatternTypeDropDown = LoadPatternTypeDropDown("LTYPE_DEAD")
setLoadPattern = DynamoSAP.Structure.LoadPattern.SetLoadPattern(code_block_2, loadPatternTypeDropDown)
code_block_3 = CodeBlock { 1; }
code_block_4 = CodeBlock { 4; }
code_block_5 = CodeBlock { 0.5; }
code_block_6 = CodeBlock { 10; }
pointLoadOnFrame = DynamoSAP.Structure.Load.PointLoadOnFrame(setLoadPattern, code_block_3, code_block_4, code_block_5, code_block_6)
setLoad = DynamoSAP.Structure.Frame.SetLoad(fromEndPoints, pointLoadOnFrame)
decompose_2 = DynamoSAP.Structure.Frame.Decompose(setLoad)
boolean = BoolSelector(false)
code_block_7 = CodeBlock { 1; }
distributedLoadOnFrame = DynamoSAP.Structure.Load.DistributedLoadOnFrame(setLoadPattern, code_block_3, code_block_4, code_block_5, code_block_7, code_block_6, code_block_6)
setLoad_2 = DynamoSAP.Structure.Frame.SetLoad(fromEndPoints, distributedLoadOnFrame)
decompose_3 = DynamoSAP.Structure.Frame.Decompose(setLoad_2)
displayLoads = DynamoSAP.Structure.Frame.DisplayLoads(setLoad)
code_block_8 = CodeBlock { "My load case"; }
code_block_9 = CodeBlock { 1.2; }
loadCaseTypeDropDown = LoadCaseTypeDropDown("CASE_LINEAR_STATIC")
setLoadCase = DynamoSAP.Structure.LoadCase.SetLoadCase(code_block_8, setLoadPattern, code_block_9, loadCaseTypeDropDown)
fixed = DynamoSAP.Structure.Restraint.Fixed(byCoordinates)
collector = DynamoSAP.Assembly.StructuralModel.Collector(setLoad, setLoadPattern, setLoadCase, fixed)
boolean_2 = BoolSelector(true)
toSAP = DynamoSAP.Assembly.Bake.ToSAP(collector, boolean_2)
boolean_3 = BoolSelector(true)
runOpenInstance = DynamoSAP.Analysis.Analysis.RunOpenInstance(boolean_3)
integer_slider = IntegerSlider(3, range=0..100)
getItemAtIndex = List.GetItemAtIndex(runOpenInstance, integer_slider)
getResults = DynamoSAP.Analysis.Analysis.GetResults(getItemAtIndex, boolean_3)
forceTypeDropDown = ForceTypeDropdown("Torsion")
decomposeResults = DynamoSAP.Analysis.Analysis.DecomposeResults(toSAP, getResults, forceTypeDropDown)
code_block_10 = CodeBlock { 200; }
visualizeResults = DynamoSAP.Analysis.Analysis.VisualizeResults(toSAP, getResults, forceTypeDropDown, code_block_10)
