# Dynamo graph Portal_sample.dyn (Dynamo 0.7.5.3282)

boolean = BoolSelector(true)
code_block = CodeBlock { "Global"; }
number = DoubleInput(4)
number_2 = DoubleInput(4)
integer_slider = IntegerSlider(5, range=0..100)
number_3 = DoubleInput(0)
double_slider = DoubleSlider(300, range=150..500)
double_slider_2 = DoubleSlider(500, range=150..500)
double_slider_3 = DoubleSlider(350, range=150..500)
xyzGrid = Custom[XyzGrid](x_count=number, y_count=number_2, z_count=integer_slider, x0=number_3, y0=number_3, z0=number_3, x_space=double_slider, y_space=double_slider_2, z_space=double_slider_3)  # This node represents an upgrade of the 0.6.3 XyzGrid node to 0.7.x
flatten = Flatten(xyzGrid)
formula = Formula("x*y;", x=number, y=number_2)
chop = List.Chop(flatten, formula)
transpose = List.Transpose(chop)
byPoints = PolyCurve.ByPoints(transpose)
explode = Geometry.Explode(byPoints)
# note: COLUMNS
flatten_2 = Flatten(explode)
startPoint = Curve.StartPoint(flatten_2)
endPoint = Curve.EndPoint(flatten_2)
code_block_2 = CodeBlock { "Steel"; }
code_block_3 = CodeBlock { "HSS12x8x1/4"; }
# note: COLUMN FRAMES
fromEndPoints = DynamoSAP.Structure.Frame.FromEndPoints(startPoint, endPoint, code_block_2, code_block_3)
create = List.Create()
number_4 = DoubleInput(1)
formula_2 = Formula("z-1", z=integer_slider)
number_sequence = NumberSeq(number_4, formula_2, number_4, lacing=Longest)
getItemAtIndex = List.GetItemAtIndex(chop, number_sequence)
flatten_3 = Flatten(getItemAtIndex)
chop_2 = List.Chop(flatten_3, number)
chop_3 = List.Chop(chop_2, number_2)
byPoints_2 = PolyCurve.ByPoints(chop_3)
explode_2 = Geometry.Explode(byPoints_2)
flatten_4 = Flatten()
map = List.Map(explode_2, flatten_4)
number_5 = DoubleInput(0)
code_block_4 = CodeBlock(x=number, y=number_2) { x*y; }
number_sequence_2 = NumberSeq(number_5, formula_2, code_block_4, lacing=Longest)
number_6 = DoubleInput(1)
number_sequence_3 = NumberSeq(number_sequence_2, number, number_6, lacing=Longest)
number_sequence_4 = NumberSeq(number_sequence_3, number_2, number, lacing=Longest)
getItemAtIndex_2 = List.GetItemAtIndex(flatten_3, number_sequence_4)
byPoints_3 = PolyCurve.ByPoints(getItemAtIndex_2)
explode_3 = Geometry.Explode(byPoints_3)
map_2 = List.Map(explode_3, flatten_4)
combine = List.Combine(create, map, map_2)
# note: BEAMS
flatten_5 = Flatten(combine)
startPoint_2 = Curve.StartPoint(flatten_5)
endPoint_2 = Curve.EndPoint(flatten_5)
code_block_5 = CodeBlock { "W12x40"; }
# note: BEAM FRAMES
fromEndPoints_2 = DynamoSAP.Structure.Frame.FromEndPoints(startPoint_2, endPoint_2, code_block_2, code_block_5)
create_2 = List.Create()
number_7 = DoubleInput(5)
number_8 = DoubleInput(6)
number_9 = DoubleInput(9)
number_10 = DoubleInput(10)
create_3 = List.Create(number_7, number_8, number_9, number_10)
getItemAtIndex_3 = List.GetItemAtIndex(explode, create_3)
transpose_2 = List.Transpose(getItemAtIndex_3)
endPoint_3 = Curve.EndPoint(transpose_2)
number_11 = DoubleInput(1)
number_12 = DoubleInput(2)
number_sequence_5 = NumberSeq(number_11, number_12, number_11, lacing=Longest)
getItemAtIndex_4 = List.GetItemAtIndex(arg1=number_sequence_5)
map_3 = List.Map(endPoint_3, getItemAtIndex_4)
flatten_6 = Flatten(map_3)
startPoint_3 = Curve.StartPoint(transpose_2)
number_13 = DoubleInput(0)
number_14 = DoubleInput(2)
number_15 = DoubleInput(3)
number_sequence_6 = NumberSeq(number_13, number_14, number_15, lacing=Longest)
getItemAtIndex_5 = List.GetItemAtIndex(arg1=number_sequence_6)
map_4 = List.Map(startPoint_3, getItemAtIndex_5)
flatten_7 = Flatten(map_4)
combine_2 = List.Combine(create_2, flatten_6, flatten_7)
flatten_8 = Flatten(combine_2)
number_16 = DoubleInput(4)
chop_4 = List.Chop(flatten_8, number_16)
boolean_2 = BoolSelector(true)
byPoints_4 = PolyCurve.ByPoints(chop_4, boolean_2)
explode_4 = Geometry.Explode(byPoints_4)
# note: CORE DIAGONALS
flatten_9 = Flatten(explode_4)
startPoint_4 = Curve.StartPoint(flatten_9)
endPoint_4 = Curve.EndPoint(flatten_9)
code_block_6 = CodeBlock { "W12x40"; }
# note: DIAGONAL FRAMES
fromEndPoints_3 = DynamoSAP.Structure.Frame.FromEndPoints(startPoint_4, endPoint_4, code_block_2, code_block_6)
create_4 = List.Create(fromEndPoints, fromEndPoints_2, fromEndPoints_3)
flatten_10 = Flatten(create_4)
code_block_7 = CodeBlock { "Live_Load_Sample"; }
loadPatternTypeDropDown = LoadPatternTypeDropDown("LTYPE_LIVE")
number_17 = DoubleInput(1.25)
setLoadPattern = DynamoSAP.Structure.LoadPattern.SetLoadPattern(code_block_7, loadPatternTypeDropDown, number_17)
code_block_8 = CodeBlock { "Dead_Load_Sample"; }
loadPatternTypeDropDown_2 = LoadPatternTypeDropDown("LTYPE_DEAD")
number_18 = DoubleInput(1.6)
setLoadPattern_2 = DynamoSAP.Structure.LoadPattern.SetLoadPattern(code_block_8, loadPatternTypeDropDown_2, number_18)
code_block_9 = CodeBlock { "Move_Load_Sample"; }
loadPatternTypeDropDown_3 = LoadPatternTypeDropDown("LTYPE_MOVE")
number_19 = DoubleInput(0.75)
setLoadPattern_3 = DynamoSAP.Structure.LoadPattern.SetLoadPattern(code_block_9, loadPatternTypeDropDown_3, number_19)
create_5 = List.Create(setLoadPattern, setLoadPattern_2, setLoadPattern_3)
flatten_11 = Flatten(create_5)
code_block_10 = CodeBlock { "Load_Case_Sample"; }
number_20 = DoubleInput(1.2)
number_21 = DoubleInput(1.3)
number_22 = DoubleInput(1.2)
create_6 = List.Create(number_20, number_21, number_22)
loadCaseTypeDropDown = LoadCaseTypeDropDown("CASE_LINEAR_STATIC")
# note: LOAD CASE
setLoadCase = DynamoSAP.Structure.LoadCase.SetLoadCase(code_block_10, create_5, create_6, loadCaseTypeDropDown)
create_7 = List.Create(setLoadCase)
flatten_12 = Flatten(create_7)
number_23 = DoubleInput(0)
getItemAtIndex_6 = List.GetItemAtIndex(chop, number_23)
takeItems = List.TakeItems(getItemAtIndex_6, number)
# note: RESTRAINTS
fixed = DynamoSAP.Structure.Restraint.Fixed(takeItems)
dropItems = List.DropItems(getItemAtIndex_6, number)
roller = DynamoSAP.Structure.Restraint.Roller(dropItems)
create_8 = List.Create(fixed, roller)
flatten_13 = Flatten(create_8)
# note: LOAD PATTERN
type_1_force_2_moment = DoubleInput(1)
load_direction_4_x_5_y_6_z = IntegerSlider(6, range=0..100)
double_slider_4 = DoubleSlider(0.25, range=0..100)
double_slider_5 = DoubleSlider(1, range=0..100)
double_slider_6 = DoubleSlider(-13.82279487, range=-100..0)
# note: LOAD
distributedLoadOnFrame = DynamoSAP.Structure.Load.DistributedLoadOnFrame(fromEndPoints_2, setLoadPattern, type_1_force_2_moment, load_direction_4_x_5_y_6_z, double_slider_4, double_slider_5, double_slider_6, double_slider_6)
load_direction_4_x_5_y_6_z_2 = IntegerSlider(5, range=0..100)
code_block_11 = CodeBlock { 0.5; }
code_block_12 = CodeBlock { 100; }
pointLoadOnFrame = DynamoSAP.Structure.Load.PointLoadOnFrame(fromEndPoints, setLoadPattern_3, type_1_force_2_moment, load_direction_4_x_5_y_6_z_2, code_block_11, code_block_12)
create_9 = List.Create(distributedLoadOnFrame, pointLoadOnFrame)
flatten_14 = Flatten(create_9)
boolean_3 = BoolSelector(true)
# note: RELEASE
setRelease = DynamoSAP.Structure.Release.SetRelease(fromEndPoints_3, arg9=boolean_3, arg11=boolean_3)
create_10 = List.Create(setRelease)
flatten_15 = Flatten(create_10)
collector = DynamoSAP.Assembly.StructuralModel.Collector(flatten_10, flatten_11, flatten_12, flatten_13, flatten_14, flatten_15)
file_path = Filename("C:\Users\AGarciaPuyol\Desktop\DynamoSAP\DynSAPTest01.sdb")
boolean_4 = BoolSelector(false)
run = DynamoSAP.Analysis.Analysis.Run(collector, file_path, boolean_4)
boolean_5 = BoolSelector(true)
getResults = DynamoSAP.Analysis.Analysis.GetResults(run, boolean_5)
integer_slider_2 = IntegerSlider(0, range=0..3)
getItemAtIndex_7 = List.GetItemAtIndex(getResults, integer_slider_2)
forceTypeDropDown = ForceTypeDropdown("Moment33")
decomposeResults = DynamoSAP.Analysis.Analysis.DecomposeResults(collector, getItemAtIndex_7, forceTypeDropDown)
watch = Watch(decomposeResults)
number_24 = DoubleInput(0.001)
visualizeResults = DynamoSAP.Analysis.Analysis.VisualizeResults(collector, getItemAtIndex_7, forceTypeDropDown, number_24)
loadPatterns = DynamoSAP.Assembly.StructuralModel.LoadPatterns(collector)
name = DynamoSAP.Structure.LoadPattern.Name(loadPatterns)
integer_slider_3 = IntegerSlider(0, range=0..100)
getItemAtIndex_8 = List.GetItemAtIndex(name, integer_slider_3)
double_slider_7 = DoubleSlider(2, range=0..10)
boolean_6 = BoolSelector(true)
double_slider_8 = DoubleSlider(20, range=1..25)
display = DynamoSAP.Structure.Load.Display(collector, getItemAtIndex_8, double_slider_7, boolean_6, double_slider_8)
boolean_7 = BoolSelector(false)
toSAP = DynamoSAP.Assembly.Bake.ToSAP(collector, boolean_7)
watch_2 = Watch(getItemAtIndex_8)
watch_3 = Watch(name)
loadCombination = DynamoSAP.Analysis.Analysis.LoadCombination(getResults)
watch_4 = Watch(loadCombination)
getItemAtIndex_9 = List.GetItemAtIndex(watch_4, integer_slider_2)
watch_5 = Watch(getItemAtIndex_9)
