# Dynamo graph Prototype blocks.dyn (Dynamo 0.7.2.2921)

FRAME = Formula("Curve + Material+ Section + Justification+Rotation")
load_case = Formula("pattern+loadName", FRAME)
load_pattern = Formula("Name + Type + Multiplier")
distributed_load = Formula("Frame+direction+amount+pattern", Frame=FRAME, pattern=load_pattern)
restraints = Formula("XX+YY+ZZ")
COLLECTOR = Formula("Frame+loadcase+distributedLoad+restraints", Frame=FRAME, loadcase=load_case, distributedLoad=distributed_load, restraints=restraints)
