# Dynamo graph Sample_1_SpaceStructure_withLoads.dyn (Dynamo 0.7.5.3566)

collector = DynamoSAP.Assembly.StructuralModel.Collector()
boolean = BoolSelector(false)
units = Units("kN_m_C")
toSAP = DynamoSAP.Assembly.Bake.ToSAP(collector, boolean, units)
byCoordinates = Point.ByCoordinates()
double_slider = DoubleSlider(6.504, range=0..100)
double_slider_2 = DoubleSlider(15, range=0..100)
double_slider_3 = DoubleSlider(10, range=0..100)
byCoordinates_2 = Point.ByCoordinates(double_slider, double_slider_2, double_slider_3)
double_slider_4 = DoubleSlider(16, range=0..100)
double_slider_5 = DoubleSlider(50, range=0..100)
byCoordinates_3 = Point.ByCoordinates(double_slider_4, double_slider_5)
byThreePoints = Arc.ByThreePoints(byCoordinates, byCoordinates_2, byCoordinates_3)
double_slider_6 = DoubleSlider(-5, range=-10..100)
byCoordinates_4 = Point.ByCoordinates(double_slider_6)
double_slider_7 = DoubleSlider(15, range=0..100)
double_slider_8 = DoubleSlider(10, range=0..100)
byCoordinates_5 = Point.ByCoordinates(double_slider_6, double_slider_7, double_slider_8)
double_slider_9 = DoubleSlider(50, range=0..100)
byCoordinates_6 = Point.ByCoordinates(double_slider_6, double_slider_9)
byThreePoints_2 = Arc.ByThreePoints(byCoordinates_4, byCoordinates_5, byCoordinates_6)
create = List.Create(byThreePoints, byThreePoints_2)
byLoft = Surface.ByLoft(create)
integer_slider = IntegerSlider(4, range=0..100)
integer_slider_2 = IntegerSlider(5, range=0..100)
# note: Geometry
lunchbox_space_truss_structure = Custom[LunchBox Space Truss Structure](Surface=byLoft, U=integer_slider, V=integer_slider, Depth=integer_slider_2)  # Create a space truss using a surface.
create_2 = List.Create(lunchbox_space_truss_structure.CenterlinesA, lunchbox_space_truss_structure.CenterlinesB, lunchbox_space_truss_structure.CenterlinesC, lunchbox_space_truss_structure.CenterlinesD)
flatten = Flatten(create_2)
sectionCatalogs = SectionCatalogs("AISC14")
sections = DynamoSAP.Definitions.SectionProp.Sections(sectionCatalogs)
code_block = CodeBlock(x=sections) { x[1902]; }
materials = Materials("A36")
# note: SectionProp
define = DynamoSAP.Definitions.SectionProp.Define(code_block, materials, sectionCatalogs)
fromLine = DynamoSAP.Structure.Frame.FromLine(flatten, define)
create_3 = List.Create(lunchbox_space_truss_structure.CenterlinesE)
fromLine_2 = DynamoSAP.Structure.Frame.FromLine(create_3, define)
code_block_2 = CodeBlock { "MyLoadPattern"; }
loadPatternTypes = LoadPatternTypes("LTYPE_DEAD")
double_slider_10 = DoubleSlider(0.75, range=0..5)
setLoadPattern = DynamoSAP.Definitions.LoadPattern.SetLoadPattern(code_block_2, loadPatternTypes, double_slider_10)
integer_slider_3 = IntegerSlider(1, range=0..100)
integer_slider_4 = IntegerSlider(6, range=0..100)
double_slider_11 = DoubleSlider(0.5, range=0..100)
double_slider_12 = DoubleSlider(100, range=0..100)
pointLoadOnFrame = DynamoSAP.Definitions.Load.PointLoadOnFrame(setLoadPattern, integer_slider_3, integer_slider_4, double_slider_11, double_slider_12)
setLoad = DynamoSAP.Structure.Frame.SetLoad(fromLine_2, pointLoadOnFrame)
create_4 = List.Create(fromLine, setLoad)
flatten_2 = Flatten(create_4)
code_block_3 = CodeBlock { "MyLoadCase"; }
double_slider_13 = DoubleSlider(1.5, range=0..4)
loadCaseTypes = LoadCaseTypes("CASE_LINEAR_STATIC")
setLoadCase = DynamoSAP.Definitions.LoadCase.SetLoadCase(code_block_3, setLoadPattern, double_slider_13, loadCaseTypes)
create_5 = List.Create(byCoordinates, byCoordinates_3, byCoordinates_4, byCoordinates_6)
# note: Frame
pinned = DynamoSAP.Definitions.Restraint.Pinned(create_5)
collector_2 = DynamoSAP.Assembly.StructuralModel.Collector(flatten_2, setLoadPattern, setLoadCase, pinned)
decompose = DynamoSAP.Assembly.StructuralModel.Decompose(collector_2)
decompose_2 = DynamoSAP.Structure.Frame.Decompose(decompose)
boolean_2 = BoolSelector(false)
displayLoads = DynamoSAP.Structure.Frame.DisplayLoads(collector_2, code_block_2, arg3=boolean_2)
flatten_3 = Flatten(displayLoads)
ZAxis = Vector.ZAxis()
translate = Geometry.Translate(flatten_3, ZAxis)
