# Dynamo graph Sample_1b_SpaceStructure_withLoads.dyn (Dynamo 0.7.5.3566)

byCoordinates = Point.ByCoordinates()
# note: Space Frame Geometry Parameters
double_slider = DoubleSlider(6.504, range=0..100)
double_slider_2 = DoubleSlider(16, range=0..100)
double_slider_3 = DoubleSlider(10, range=0..100)
byCoordinates_2 = Point.ByCoordinates(double_slider, double_slider_2, double_slider_3)
double_slider_4 = DoubleSlider(16, range=0..100)
double_slider_5 = DoubleSlider(50, range=0..100)
byCoordinates_3 = Point.ByCoordinates(double_slider_4, double_slider_5)
byThreePoints = Arc.ByThreePoints(byCoordinates, byCoordinates_2, byCoordinates_3)
double_slider_6 = DoubleSlider(-5, range=-10..100)
byCoordinates_4 = Point.ByCoordinates(double_slider_6)
double_slider_7 = DoubleSlider(15, range=0..100)
double_slider_8 = DoubleSlider(10, range=0..100)
byCoordinates_5 = Point.ByCoordinates(double_slider_6, double_slider_7, double_slider_8)
double_slider_9 = DoubleSlider(50, range=0..100)
byCoordinates_6 = Point.ByCoordinates(double_slider_6, double_slider_9)
byThreePoints_2 = Arc.ByThreePoints(byCoordinates_4, byCoordinates_5, byCoordinates_6)
create = List.Create(byThreePoints, byThreePoints_2)
byLoft = Surface.ByLoft(create)
integer_slider = IntegerSlider(4, range=0..100)
integer_slider_2 = IntegerSlider(5, range=0..100)
lunchbox_space_truss_structure = Custom[LunchBox Space Truss Structure](Surface=byLoft, U=integer_slider, V=integer_slider, Depth=integer_slider_2)  # Create a space truss using a surface.
create_2 = List.Create(lunchbox_space_truss_structure.CenterlinesA, lunchbox_space_truss_structure.CenterlinesB, lunchbox_space_truss_structure.CenterlinesD, lunchbox_space_truss_structure.CenterlinesE)
# note: Space Frame Geometry
flatten = Flatten(create_2)
sectionCatalogs = SectionCatalogs("AISC14")
sections = DynamoSAP.Definitions.SectionProp.Sections(sectionCatalogs)
# note: Get Sections Names from given Section Catalog (Make sure SAP Model is Open )
code_block = CodeBlock(x=sections) { x[1902]; }
section_name = Watch(code_block)
materials = Materials("A36")
# note: Define Section Property for Frames
define = DynamoSAP.Definitions.SectionProp.Define(section_name, materials, sectionCatalogs)
# note: Define Frame from Line
fromLine = DynamoSAP.Structure.Frame.FromLine(flatten, define)
fromLine_2 = DynamoSAP.Structure.Frame.FromLine(lunchbox_space_truss_structure.CenterlinesC, define)
string = StringInput("MyLoadPattern")
loadPatternTypes = LoadPatternTypes("LTYPE_DEAD")
double_slider_10 = DoubleSlider(1.25, range=0..2)
# note: Create a Load Pattern.
setLoadPattern = DynamoSAP.Definitions.LoadPattern.SetLoadPattern(string, loadPatternTypes, double_slider_10)
loadType = LoadType("Force")
loadDirection = LoadDirection("b_GlobalZ")
double_slider_11 = DoubleSlider(0, range=0..1)
double_slider_12 = DoubleSlider(1, range=0..1)
double_slider_13 = DoubleSlider(-50, range=-100..100)
coordinateSystem = CoordinateSystem("Global")
# note: Create a Load. This can be a Point Load or a Distributed Load
distributedLoad = DynamoSAP.Definitions.Load.DistributedLoad(setLoadPattern, loadType, loadDirection, double_slider_11, double_slider_12, double_slider_13, double_slider_13, coordinateSystem)
# note: Define Loads for some of the frames
setLoad = DynamoSAP.Structure.Frame.SetLoad(fromLine_2, distributedLoad)
# note: Make sure you flatten the list of Structural Elements to be fed into the collector
create_3 = List.Create(fromLine, setLoad)
flatten_2 = Flatten(create_3)
# note: Collector for Structural Model with Definitions
collector = DynamoSAP.Assembly.StructuralModel.Collector(flatten_2, setLoadPattern)
boolean = BoolSelector(true)
units = Units("kN_m_C")
# note: Bake to SAP model! set Delete true if you like overwrite the existing model.
toSAP = DynamoSAP.Assembly.Bake.ToSAP(collector, boolean, units)
double_slider_14 = DoubleSlider(0.5, range=0..100)
boolean_2 = BoolSelector(true)
# note: Display Loads in Dynamo
displayLoads = DynamoSAP.Structure.Frame.DisplayLoads(collector, arg2=double_slider_14, arg3=boolean_2)
