# Dynamo graph Space_structure.dyn (Dynamo 0.7.6.3423)

code_block = CodeBlock { 5; }
code_block_2 = CodeBlock(n=code_block) { 0..#5..n; }
byCoordinates = Point.ByCoordinates(arg1=code_block_2)
code_block_3 = CodeBlock { 5; }
code_block_4 = CodeBlock { 7; }
code_block_5 = CodeBlock { 5; }
code_block_6 = CodeBlock { 10; }
code_block_7 = CodeBlock { 7; }
create = List.Create(code_block_3, code_block_4, code_block_5, code_block_6, code_block_7)
code_block_8 = CodeBlock { 0; }
ofRepeatedItem = List.OfRepeatedItem(code_block_8, code_block)
code_block_9 = CodeBlock { 180; }
ofRepeatedItem_2 = List.OfRepeatedItem(code_block_9, code_block)
YAxis = Vector.YAxis()
ofRepeatedItem_3 = List.OfRepeatedItem(YAxis, code_block)
byCenterPointRadiusAngle = Arc.ByCenterPointRadiusAngle(byCoordinates, create, ofRepeatedItem, ofRepeatedItem_2, ofRepeatedItem_3)
byLoft = PolySurface.ByLoft(byCenterPointRadiusAngle)
code_block_10 = CodeBlock { 10; }
code_block_11 = CodeBlock { 15; }
lunchbox_braced_grid_stucture_1d = Custom[LunchBox Braced Grid Stucture 1D](Surface=byLoft, U=code_block_10, V=code_block_11)  # Creates a 1D braced grid structure on a surface
define = DynamoSAP.Structure.SectionProp.Define()
fromLine = DynamoSAP.Structure.Frame.FromLine(lunchbox_braced_grid_stucture_1d.Centerlines_A, define)
watch_3d = Watch3D(fromLine)
code_block_12 = CodeBlock { "Space Structure pattern"; }
loadPatternTypeDropDown = LoadPatternTypeDropDown("LTYPE_DEAD")
code_block_13 = CodeBlock { 1; }
setLoadPattern = DynamoSAP.Structure.LoadPattern.SetLoadPattern(code_block_12, loadPatternTypeDropDown, code_block_13)
code_block_14 = CodeBlock { 1; }
code_block_15 = CodeBlock { 4; }
code_block_16 = CodeBlock { 0; }
code_block_17 = CodeBlock { 1; }
code_block_18 = CodeBlock { 10; }
distributedLoadOnFrame = DynamoSAP.Structure.Load.DistributedLoadOnFrame(setLoadPattern, code_block_14, code_block_15, code_block_16, code_block_17, code_block_18, code_block_18)
setLoad = DynamoSAP.Structure.Frame.SetLoad(fromLine, distributedLoadOnFrame)
fromLine_2 = DynamoSAP.Structure.Frame.FromLine(lunchbox_braced_grid_stucture_1d.Centerlines_B, define)
fromLine_3 = DynamoSAP.Structure.Frame.FromLine(lunchbox_braced_grid_stucture_1d.Centerlines_C, define)
create_2 = List.Create(setLoad, fromLine_2, fromLine_3)
flatten = Flatten(create_2)
code_block_19 = CodeBlock { 0.01; }
boolean = BoolSelector(false)
code_block_20 = CodeBlock { 0.1; }
displayLoads = DynamoSAP.Structure.Frame.DisplayLoads(flatten, code_block_12, code_block_19, boolean, code_block_20)
decompose = DynamoSAP.Structure.Frame.Decompose(flatten)
code_block_21 = CodeBlock { "Space structure LC"; }
code_block_22 = CodeBlock { 1.2; }
loadCaseTypeDropDown = LoadCaseTypeDropDown("CASE_LINEAR_STATIC")
setLoadCase = DynamoSAP.Structure.LoadCase.SetLoadCase(code_block_21, setLoadPattern, code_block_22, loadCaseTypeDropDown)
endPoint = Curve.EndPoint(lunchbox_braced_grid_stucture_1d.Centerlines_A)
startPoint = Curve.StartPoint(lunchbox_braced_grid_stucture_1d.Centerlines_A)
create_3 = List.Create(endPoint, startPoint)
flatten_2 = Flatten(create_3)
Z = Vector.Z(flatten_2)
python_script = Python(IN[0]=Z, IN[1]=flatten_2)
# ---------- python_script.python (15 lines) ----------
import clr
clr.AddReference('ProtoGeometry')
from Autodesk.DesignScript.Geometry import *


#The inputs to this node will be stored as a list in the IN variable.
dataEnteringNode = IN
pt=[]
for i in range(0,IN[0].Count,1):
 	if(round(IN[0][i],2)==0.0):
 		
 		pt.append(IN[1][i])

#Assign your output to the OUT variable
OUT = pt
# ----------------------------------------
pinned = DynamoSAP.Structure.Restraint.Pinned(python_script)
collector = DynamoSAP.Assembly.StructuralModel.Collector(flatten, setLoadPattern, setLoadCase, pinned)
boolean_2 = BoolSelector(false)
toSAP = DynamoSAP.Assembly.Bake.ToSAP(collector, boolean_2)
boolean_3 = BoolSelector(false)
lunchbox_diagrid_structure = Custom[LunchBox Diagrid Structure](Surface=byLoft, U=code_block_10, V=code_block_11, TypeBool=boolean_3)  # Creates a diagrid structure on a surface.
