# Dynamo graph TT_workshop_portal_sample.dyn (Dynamo 0.7.5.3566)

# note: COLUMNS
flatten = Flatten()
startPoint = Curve.StartPoint(flatten)
endPoint = Curve.EndPoint(flatten)
sectionCatalogs = SectionCatalogs("AISC")
sections = DynamoSAP.Definitions.SectionProp.Sections(sectionCatalogs)
code_block = CodeBlock { 2; }
getItemAtIndex = List.GetItemAtIndex(sections, code_block)
code_block_2 = CodeBlock { "Steel"; }
define = DynamoSAP.Definitions.SectionProp.Define(getItemAtIndex, code_block_2, sectionCatalogs)
# note: COLUMN FRAMES
fromEndPoints = DynamoSAP.Structure.Frame.FromEndPoints(startPoint, endPoint, define)
boolean = BoolSelector(false)
run = DynamoSAP.Analysis.Analysis.Run(boolean)
integer_slider = IntegerSlider(3, range=0..5)
getItemAtIndex_2 = List.GetItemAtIndex(run.out2, integer_slider)
double_slider = DoubleSlider(1.078, range=0..2)
boolean_2 = BoolSelector(true)
double_slider_2 = DoubleSlider(2, range=0..2)
displayLoads = DynamoSAP.Structure.Frame.DisplayLoads(run.out0, getItemAtIndex_2, double_slider, boolean_2, double_slider_2)
boolean_3 = BoolSelector(true)
getResults = DynamoSAP.Analysis.Analysis.GetResults(getItemAtIndex_2, boolean_3)
forceTypes = ForceTypes("Axial")
decomposeResults = DynamoSAP.Analysis.Analysis.DecomposeResults(run.out0, getResults, forceTypes)
double_slider_3 = DoubleSlider(0.05, range=0..10)
visualizeResults = DynamoSAP.Analysis.Analysis.VisualizeResults(run.out0, getResults, forceTypes, boolean_3, double_slider_3)
# note: BEAMS
flatten_2 = Flatten()
startPoint_2 = Curve.StartPoint(flatten_2)
endPoint_2 = Curve.EndPoint(flatten_2)
# note: BEAM FRAMES
fromEndPoints_2 = DynamoSAP.Structure.Frame.FromEndPoints(startPoint_2, endPoint_2, define)
code_block_3 = CodeBlock { "Dead_Load_Sample"; }
loadPatternTypes = LoadPatternTypes("LTYPE_DEAD")
number = DoubleInput(1.6)
setLoadPattern = DynamoSAP.Definitions.LoadPattern.SetLoadPattern(code_block_3, loadPatternTypes, number)
code_block_4 = CodeBlock { "Force"; }
load_direction_4_x_5_y_6_z = IntegerSlider(5, range=0..100)
double_slider_4 = DoubleSlider(0, range=0..100)
double_slider_5 = DoubleSlider(1, range=0..100)
double_slider_6 = DoubleSlider(-15, range=-100..0)
distributedLoad = DynamoSAP.Definitions.Load.DistributedLoad(setLoadPattern, code_block_4, load_direction_4_x_5_y_6_z, double_slider_4, double_slider_5, double_slider_6, double_slider_6)
# note: BEAM FRAMES w/LOADS
setLoad = DynamoSAP.Structure.Frame.SetLoad(fromEndPoints_2, distributedLoad)
create = List.Create(arg1=setLoad)
# note: ALL FRAMES IN THE PROJECT
flatten_3 = Flatten(create)
# note: COLLECTOR
collector = DynamoSAP.Assembly.StructuralModel.Collector(flatten_3)
decompose = DynamoSAP.Assembly.StructuralModel.Decompose(run.out0)
decompose_2 = DynamoSAP.Structure.Frame.Decompose(decompose)
code_block_5 = CodeBlock { "Live_Load_Sample"; }
loadPatternTypes_2 = LoadPatternTypes("LTYPE_LIVE")
number_2 = DoubleInput(1.25)
setLoadPattern_2 = DynamoSAP.Definitions.LoadPattern.SetLoadPattern(code_block_5, loadPatternTypes_2, number_2)
# note: LOAD PATTERNS
create_2 = List.Create(setLoadPattern_2, setLoadPattern)
# note: ALL LOAD PATTERNS IN THE PROJECT
flatten_4 = Flatten(create_2)
code_block_6 = CodeBlock { "Load_Case_Sample"; }
number_3 = DoubleInput(1.2)
number_4 = DoubleInput(1.3)
number_5 = DoubleInput(1.2)
create_3 = List.Create(number_3, number_4, number_5)
loadCaseTypes = LoadCaseTypes("CASE_LINEAR_STATIC")
# note: LOAD CASE
setLoadCase = DynamoSAP.Definitions.LoadCase.SetLoadCase(code_block_6, create_2, create_3, loadCaseTypes)
create_4 = List.Create(setLoadCase)
# note: ALL LOAD CASES IN THE PROJECT
flatten_5 = Flatten(create_4)
create_5 = List.Create(flatten_4, flatten_5)
flatten_6 = Flatten(create_5)
collector_2 = DynamoSAP.Assembly.StructuralModel.Collector(flatten_3, flatten_6)
# note: TRANSLATION INTO SAP
boolean_4 = BoolSelector(true)
units = Units("N_m_C")
toSAP = DynamoSAP.Assembly.Bake.ToSAP(collector_2, boolean_4, units)
byCoordinates = Point.ByCoordinates()
length_in_the_y_direction = DoubleSlider(43.49686679, range=0..100)
byCoordinates_2 = Point.ByCoordinates(arg1=length_in_the_y_direction)
byStartPointEndPoint = Line.ByStartPointEndPoint(byCoordinates, byCoordinates_2)
number_of_divisions_in_the_x = IntegerSlider(5, range=2..20)  # "Number of divisions in the X direction"
divideEqually = Curve.DivideEqually(byStartPointEndPoint, number_of_divisions_in_the_x)
startPoint_3 = Curve.StartPoint(divideEqually)
endPoint_3 = Curve.EndPoint(divideEqually)
lastItem = List.LastItem(endPoint_3)
create_6 = List.Create(startPoint_3, lastItem)
# note: Support points
flatten_7 = Flatten(create_6)
height = DoubleSlider(13.8363575, range=0..100)
byCoordinates_3 = Vector.ByCoordinates(arg2=height)
translate = Geometry.Translate(byStartPointEndPoint, byCoordinates_3)
# note: Top lines
divideEqually_2 = Curve.DivideEqually(translate, number_of_divisions_in_the_x)
startPoint_4 = Curve.StartPoint(divideEqually_2)
endPoint_4 = Curve.EndPoint(divideEqually_2)
lastItem_2 = List.LastItem(endPoint_4)
create_7 = List.Create(startPoint_4, lastItem_2)
flatten_8 = Flatten(create_7)
# note: Vertical lines
byStartPointEndPoint_2 = Line.ByStartPointEndPoint(flatten_7, flatten_8)
