# Dynamo graph simpletest.dyn (Dynamo 0.7.2.2921)

byCoordinates = Point.ByCoordinates()
double_slider = DoubleSlider(47.119, range=0..100)
double_slider_2 = DoubleSlider(59.46, range=0..100)
byCoordinates_2 = Point.ByCoordinates(double_slider, double_slider_2)
code_block = CodeBlock { "MySteel"; }
code_block_2 = CodeBlock { "W12x15"; }
integer_slider = IntegerSlider(4, range=0..7)
double_slider_3 = DoubleSlider(90.123, range=0..100)
fromEndPoints = DynamoSAP.Structure.Frame.FromEndPoints(byCoordinates, byCoordinates_2, code_block, code_block_2, integer_slider, double_slider_3)
baseCurve = DynamoSAP.Structure.Frame.BaseCurve(fromEndPoints)
rotation = DynamoSAP.Structure.Frame.Rotation(fromEndPoints)
toString = ToString(fromEndPoints)
createSAPModel = DynamoSAP.Assembly.SAPModel.CreateSAPModel()
watch = Watch(createSAPModel)
setLoadPattern = DynamoSAP.Analysis.LoadPattern.SetLoadPattern(code_block, integer_slider, double_slider_3)
patternName = DynamoSAP.Analysis.LoadPattern.PatternName(setLoadPattern)
loadMultiplier = DynamoSAP.Analysis.LoadPattern.LoadMultiplier(setLoadPattern)
integer_slider_2 = IntegerSlider(28, range=0..100)
double_slider_4 = DoubleSlider(28.379, range=0..100)
code_block_3 = CodeBlock { "mysds"; }
boolean = BoolSelector(true)
pointLoadOnFrame = DynamoSAP.Analysis.Load.PointLoadOnFrame(fromEndPoints, setLoadPattern, integer_slider_2, integer_slider_2, double_slider_4, double_slider_4, code_block_3, boolean, boolean)
name = DynamoSAP.Analysis.Load.Name(pointLoadOnFrame)
pattern = DynamoSAP.Analysis.Load.Pattern(pointLoadOnFrame)
