# Dynamo graph Prototype blocks.dyn (Dynamo 0.7.2.2921)

FRAME = Formula("Curve + Material+ Section + Justification+Rotation")
load_pattern = Formula("Name + Type + Multiplier")
load_case = Formula("pattern+loadName", load_pattern)
load_pattern_2 = Formula("Name + Type + Multiplier")
PATTERNS = List.Create(load_pattern, load_pattern_2)
restraints = Formula("XX+YY+ZZ")
distributed_load = Formula("Frame+direction+amount+pattern", Frame=FRAME, pattern=load_pattern)
code_block = CodeBlock { "Vector as Vector3d"; }
point_load_on_frame = Formula("frame+t+vector+amount+pattern", frame=FRAME, vector=code_block, pattern=load_pattern_2)
LOADS = List.Create(distributed_load, point_load_on_frame)
COLLECTOR = Formula("Frame+loadcase+Pattern+restraints+Loads", Frame=FRAME, loadcase=load_case, Pattern=PATTERNS, restraints=restraints, Loads=LOADS)
code_block_2 = CodeBlock { "is this supposed to be here?"; }
