# Dynamo graph Workflow_SapToDynamo.dyn (Dynamo 0.7.3.3034)

# note: Read SapModel
read_sap_model = CodeBlock()
# ---------- read_sap_model.designscript (8 lines) ----------
def ReadSapModel()
{
 return = SapModel;
}
def ReadSapModel(filepath)
{
return = SapModel;
}
# ----------------------------------------
# note: SAP to DYNAMO
file_path = Filename("No file selected.")
read_existing_sap_model = CodeBlock(filepath=file_path) { ReadSapModel(filepath); }
get_frames = CodeBlock()
# ---------- get_frames.designscript (4 lines) ----------
def GetFrames(SapModel)
{
 return = List<Frame> frms;
}
# ----------------------------------------
deConstructFrm = CodeBlock()
# ---------- deConstructFrm.designscript (4 lines) ----------
def deConstructFrm(frame)
{
 return = {"BaseCurve","Material","SectionProfile","Justification","Rotation"};
}
# ----------------------------------------
read_existing_sap_model_already = CodeBlock { ReadSapModel(); }  # "Read Existing Sap Model(already -opened)"
# note: GetFrames returns List<Frame> Frames
get_frames_2 = CodeBlock(SapModel=read_existing_sap_model_already) { GetFrames(SapModel); "List<Frame> frms"; }
# note: 1. Use Query Nodes
baseCurve = DynamoSAP.Structure.Frame.BaseCurve(get_frames_2.out0)
# note: 2. Use deConstructFrm Node
deConstructFrm_2 = CodeBlock(frame=get_frames_2.out0) { deConstructFrm(frame); "BaseCurve"; "Material"; "SectionProfile"; "Justification"; "Rotation"; }
getLoadPatterns = CodeBlock()
# ---------- getLoadPatterns.designscript (4 lines) ----------
def GetLoadPatterns(SapModel)
{
 return = List<LoadPattern> Lpatterns;
}
# ----------------------------------------
# note: GetLoadPatterns returns List<LoadPattern> LPs
get_loadpatterns = CodeBlock(SapModel=read_existing_sap_model_already) { GetLoadPatterns(SapModel); "List<LoadPattern> Lpatterns"; }
name = DynamoSAP.Analysis.LoadPattern.Name(get_loadpatterns.out0)
type = DynamoSAP.Analysis.LoadPattern.Type(get_loadpatterns.out0)
deConstructLoadPattern = CodeBlock()
# ---------- deConstructLoadPattern.designscript (4 lines) ----------
def deConstructLoadPattern(loadpattern)
{
 return = {"Name","Type","Multiplier"};
}
# ----------------------------------------
# note: 2. Use deConstructLoadPattern Node
deConstructLoadpattern = CodeBlock(loadPattern=get_loadpatterns.out0) { deConstructLoadPattern(loadPattern); "Name"; "Type"; "Multiplier"; }
get_areas = CodeBlock()
# ---------- get_areas.designscript (4 lines) ----------
def GetAreas(SapModel)
{
 return = List<saparea> areas;
}
# ----------------------------------------
# note: GetAreas returns List<Area> sapAreas
get_areas_2 = CodeBlock(SapModel=read_existing_sap_model_already) { GetAreas(SapModel); "List<saparea> areas"; }
surface = CodeBlock(get_areas_2.out0) { x= SapArea.Srf; }  # "Area.Surface"
thickness = CodeBlock(get_areas_2.out0) { x= SapArea.Thick; }  # "Area.Thickness"
# note: TODO: For Area objects (slab or wall) u can use Query Nodes , thickness and surface
thicken = Surface.Thicken(surface, thickness)
deConstructArea = CodeBlock()
# ---------- deConstructArea.designscript (4 lines) ----------
def deConstructArea(area)
{
 return = {"Srf","SectionProfile","Thickness"};
}
# ----------------------------------------
# note: 2. Use deConstructArea Node
deConstructArea_2 = CodeBlock(SapArea=get_areas_2.out0) { deConstructArea(SapArea); "Srf"; "SectionProfile"; "Thickness"; }
deConstructLoadCase = CodeBlock()
# ---------- deConstructLoadCase.designscript (4 lines) ----------
def deConstructLoadCase(loadcase)
{
 return = {"Name","Type","LoadPatterns","SFs"};
}
# ----------------------------------------
# note: GetLoadCases returns List<LoadCases> LCs
getLoadCases = CodeBlock(SapModel=read_existing_sap_model_already) { GetLoadCases(SapModel); "List<LoadCase> LCases"; }
# note: 2. Use deConstructLoadCase Node
deConstructLoadCase_2 = CodeBlock(loadCase=getLoadCases.out0) { deConstructLoadCase(loadCase); }
name_2 = DynamoSAP.Analysis.LoadCase.Name(getLoadCases.out0)
type_2 = DynamoSAP.Analysis.LoadCase.Type(getLoadCases.out0)
getLoadCases_2 = CodeBlock()
# ---------- getLoadCases_2.designscript (4 lines) ----------
def GetLoadCases(SapModel)
{
 return = List<LoadCase> LCases;
}
# ----------------------------------------
get_loads = CodeBlock()
# ---------- get_loads.designscript (4 lines) ----------
def GetLoads(SapModel,frms)
{
 return = List<Load> loads;
}
# ----------------------------------------
get_loads_2 = CodeBlock(SapModel=read_existing_sap_model_already, frms=get_frames_2.out0) { GetLoads(SapModel,frms); "List<Load> loads"; }
LType = DynamoSAP.Analysis.Load.LType(get_loads_2.out0)
deConstructPointLoad = CodeBlock()
# ---------- deConstructPointLoad.designscript (4 lines) ----------
def deConstructPointLoad(load)
{
 return = {"LPattern","Type","Direction","dist", "Val"};
}
# ----------------------------------------
deConstructDistributedLoad = CodeBlock()
# ---------- deConstructDistributedLoad.designscript (4 lines) ----------
def deConstructDistributedLoad(load)
{
 return = {"LPattern","Type","Direction","dist","dist2", "Val", "Val2"};
}
# ----------------------------------------
# note: 2. Use deConstructLoad Nodes
deConstructPointLoad_2 = CodeBlock(load=get_loads_2.out0) { deConstructPointLoad(load); "LPattern"; "Type"; "Direction"; "dist"; "Val"; }
deConstructDistributedLoad_2 = CodeBlock(load=get_loads_2.out0) { deConstructDistributedLoad(load); "LPattern"; "Type"; "Direction"; "dist"; "dist2"; "Val"; "Val2"; }
